# Dynamo graph 2RengaDyn_Sample_EditMappingPSetsFile.dyn (Dynamo 2.12.0.5650)
# packages: RengaDyn 1.6.1

application = DynRenga.DynDocument.Application.Application()
project = DynRenga.DynDocument.Project.Project.Project(renga_application=application)
propertyManager = DynRenga.DynProperties.Properties.PropertyManager.PropertyManager(renga_project=project)

# group: Получение имен свойств
code_block = CodeBlock()
# ---------- code_block.designscript (3 lines) ----------
{"а": "a", "б": "b", "в": "v", "г": "g", "д": "d", "е": "e", "ё": "e", "ж": "zh", "з": "z", "и": "i", "й": "i", "к": "k", "л": "l", "м": "m", "н": "n", "о": "o", "п": "p", "р": "r", "с": "s", "т": "t", "у": "u", "ф": "f", "х": "kh", "ц": "ts", "ч": "ch", "ш": "sh", "щ": "shch", "ы": "y", "ъ": "ie", "ь": "'", "э": "e", "ю": "iu", "я": "ia", "А": "A", "Б": "B", "В": "V", "Г": "G", "Д": "D", "Е": "E", "Ё": "E", "Ж": "Zh", "З": "Z", "И": "I", "Й": "I", "К": "K", "Л": "L", "М": "M", "Н": "N", "О": "O", "П": "P", "Р": "R", "С": "S", "Т": "T", "У": "U", "Ф": "F", "Х": "Kh", "Ц": "Ts", "Ч": "Ch", "Ш": "Sh", "Щ": "Shch", "Ы": "Y", "Ъ": "Ie", "Ь": "'", "Э": "E", "Ю": "Iu", "Я": "Ia", "a": "a", "b": "b", "c": "c", "d": "d", "e": "e", "f": "f", "g": "g", "h": "h", "i": "i", "j": "j", "k": "k", "l": "l", "m": "m", "n": "n", "o": "o", "p": "p", "q": "q", "r": "r", "s": "s", "t": "t", "u": "u", "v": "v", "w": "w", "x": "x", "y": "y", "z": "z", "A": "A", "B": "B", "C": "C", "D": "D", "E": "E", "F": "F", "G": "G", "H": "H", "I": "I", "J": "J", "K": "K", "L": "L", "M": "M", "N": "N", "O": "O", "P": "P", "Q": "Q", "R": "R", "S": "S", "T": "T", "U": "U", "V": "V", "W": "W", "X": "X", "Y": "Y", "Z": "Z", "0": "0", "1": "1", "2": "2", "3": "3", "4": "4", "5": "5", "6": "6", "7": "7", "8": "8", "9": "9", ".": ".", ",": ",", "!": "!", "?": "?", ":": ":", ";
": ";
", "-": "-", "_": "_", " ": " ", "(": "(", ")": ")", "[": "[", "]": "]", "{": "{", "}": "}", "\"": "\"", "'": "'", "@": "@", "#": "#", "$": "$", "%": "%", "^": "^", "&": "&", "*": "*", "+": "+", "=": "=", "/": "/", "\\": "\\", "|": "|"};
# ----------------------------------------
getAllProperties = DynRenga.DynProperties.Properties.PropertyManager.GetAllProperties(propertyManager=propertyManager)
getPropertyName = DynRenga.DynProperties.Properties.PropertyManager.GetPropertyName(propertyManager=propertyManager, property_id=getAllProperties)
toLower = String.ToLower(string=getPropertyName)
транслитеррация = Python(IN[0]=[code_block, code_block, code_block], IN[1]=toLower)  # IronPython2
# ---------- транслитеррация.python (10 lines) ----------
dict_in = IN[0]
input_list = IN[1]

output_list = list()
for one_str in input_list:
	temp_str = ""
	for char_one in one_str:
		temp_str += dict_in[char_one]
	output_list.append(temp_str)
OUT = output_list
# ----------------------------------------

stringByGuid = DynRenga.Other.RengaSimpleInterfaces.StringByGuid(guid=getAllProperties)

# group: Сопоставление свойств с категориями объектов Ренга
allObjectTypes = DynRenga.DynObjects.General.AllObjectTypes()
list_create = List.Create(item0=allObjectTypes)
count = List.Count(list=getAllProperties)
cycle = List.Cycle(list=list_create, amount=count)
isPropertyAssignedToTypes = DynRenga.DynProperties.Properties.PropertyManager.IsPropertyAssignedToTypes(propertyManager=propertyManager, property_id=getAllProperties, object_types=allObjectTypes)
filterByBoolMask = List.FilterByBoolMask(list=cycle, mask=isPropertyAssignedToTypes)
byKeysValues = DesignScript.Builtin.Dictionary.ByKeysValues(keys=stringByGuid, values=filterByBoolMask.in)

# group: Сопоставление классов IFC и объектов Ренга
file_path = Filename("..\IFCMap\export_type.json")
python_script = Python(IN[0]=file_path, IN[1]=allObjectTypes)  # IronPython2
# ---------- python_script.python (33 lines) ----------
#Настоящий скрипт является частью обучающего курса по Renga API https://github.com/GeorgGrebenyuk/renga_programming_course_1
import json
from json import *
#Входные параметры
path_to_export_type_file = IN[0]
all_objects_categories = IN[1]

#фиксация итоговых контейнеров
type2ifc_types = dict()
def get_str_before_point(input_string):
    str_part = ""
    p_index = input_string.find(".")
    if p_index != -1:
        str_part = input_string[:p_index]
    else:
        str_part = input_string
    return str_part
#чтение файла
for one_category in all_objects_categories:
    assotiated_types = list()
    with open(path_to_export_type_file, "r") as source_file:
        source_data = json.load(source_file)
        for key in source_data:
            if key[0:3] == "Ifc":
                ifc_type = get_str_before_point(key)
                values = source_data[key]
                for one_value in values:
                    value_string = get_str_before_point(one_value).replace("{","").replace("}","")
                    if (value_string == str(one_category)):
                        assotiated_types.append(ifc_type)
                        break
    type2ifc_types[str(one_category)] = assotiated_types
OUT = type2ifc_types
# ----------------------------------------

file_path_2 = Filename("..\IFCMap\export_attr_qto_pset.json")
python_script_2 = Python(IN[0]=byKeysValues, IN[1]=toLower, IN[2]=python_script, IN[3]=file_path_2, IN[4]=stringByGuid)  # IronPython2; frozen
# ---------- python_script_2.python (40 lines) ----------
#Настоящий скрипт является частью обучающего курса по Renga API https://github.com/GeorgGrebenyuk/renga_programming_course_1
import json
from json import *

#сходные данные
properties_types = IN[0]
properties_names = IN[1]
objects2ifc_types = IN[2]
json_qset_type_path = IN[3]
#renga_project_path = IN[4]
json_out = dict()
with open(json_qset_type_path, "r") as source_file:
	json_out = json.load(source_file)
	for property_id_str,to_objects in properties_types.items():
		#Получим ifc-типы в которые выгружаются объекты
		prop_index = IN[4].index(property_id_str)
		property_name = properties_names[prop_index]
		ifc_types_list = list()
		for one_applied_object_category_guid in to_objects:
			one_applied_object_category = str(one_applied_object_category_guid)
			ifc_types_list_one = objects2ifc_types[one_applied_object_category]
			for ifc_type_one in ifc_types_list_one:
				if ifc_type_one not in ifc_types_list:
					json_ifc_to_that_group = json_out.get(ifc_type_one,None)
					if json_ifc_to_that_group != None:
						json_psets = json_ifc_to_that_group.get("psets",None)
						if json_psets != None:
							json_pset_common = json_psets.get("Pset_properties", None)
							if json_pset_common == None:
								json_psets["Pset_properties"] = dict()
								json_pset_common = json_psets["Pset_properties"]
							#Заносим наше свойство с проверкой нет ли его
							check_exist_property = json_pset_common.get(property_name, None)
							if check_exist_property == None:
								json_pset_common[property_name] = "{" + str(property_id_str) + "}"
	source_file.close()
with open(json_qset_type_path.replace(".json","_1.json"), "w") as jsonFile:
    json.dump(json_out, jsonFile, ensure_ascii=False, indent=4)
    jsonFile.close()
OUT = 0
# ----------------------------------------
python_script_3 = Python(IN[0]=byKeysValues, IN[1]=toLower, IN[2]=python_script, IN[3]=file_path_2, IN[4]=stringByGuid)  # IronPython2
# ---------- python_script_3.python (60 lines) ----------
import json
from System.Text import Encoding

# Функция для чтения JSON файла
def read_json_file(file_path):
    # Открываем файл в бинарном режиме
    with open(file_path, "rb") as source_file:
        # Читаем содержимое файла
        byte_content = source_file.read()
        # Декодируем содержимое в UTF-8
        decoded_content = byte_content.decode('utf-8')
        # Загружаем данные JSON
        return json.loads(decoded_content)

# Функция для записи JSON файла
def write_json_file(file_path, data):
    # Кодируем данные в JSON с ensure_ascii=False
    json_content = json.dumps(data, ensure_ascii=False, indent=4)
    # Открываем файл в бинарном режиме для записи
    with open(file_path, "wb") as jsonFile:
        # Записываем закодированные данные
        jsonFile.write(json_content.encode('utf-8'))

# Исходные данные
properties_types = IN[0]
properties_names = IN[1]
objects2ifc_types = IN[2]
json_qset_type_path = IN[3]

# Читаем JSON файл
json_out = read_json_file(json_qset_type_path)

# Обработка данных
for property_id_str, to_objects in properties_types.items():
    prop_index = IN[4].index(property_id_str)
    property_name = properties_names[prop_index]
    ifc_types_list = list()
    
    for one_applied_object_category_guid in to_objects:
        one_applied_object_category = str(one_applied_object_category_guid)
        ifc_types_list_one = objects2ifc_types[one_applied_object_category]
        
        for ifc_type_one in ifc_types_list_one:
            if ifc_type_one not in ifc_types_list:
                json_ifc_to_that_group = json_out.get(ifc_type_one, None)
                if json_ifc_to_that_group is not None:
                    json_psets = json_ifc_to_that_group.get("psets", None)
                    if json_psets is not None:
                        json_pset_common = json_psets.get("Pset_properties", None)
                        if json_pset_common is None:
                            json_psets["Pset_properties"] = dict()
                            json_pset_common = json_psets["Pset_properties"]
                        check_exist_property = json_pset_common.get(property_name, None)
                        if check_exist_property is None:
                            json_pset_common[property_name] = "{" + str(property_id_str) + "}"

# Записываем изменения в новый JSON файл
write_json_file(json_qset_type_path.replace(".json", "_1.json"), json_out)

OUT = 0
# ----------------------------------------
